# Dynamo graph categorie.dyn (Dynamo 3.6.1.9895)

categories = Categories("OST_Ceilings")
categories_2 = Categories("OST_Floors")
categories_3 = Categories("OST_Walls")
all_elements_of_category = ElementsOfCategory(Category=categories_3)
python_script = Python(IN[0]=all_elements_of_category)  # CPython3
# ---------- python_script.python (43 lines) ----------
import clr
clr.AddReference('RevitAPI')
clr.AddReference('RevitServices')
from Autodesk.Revit.DB import *
from RevitServices.Persistence import DocumentManager
from RevitServices.Transactions import TransactionManager

doc = DocumentManager.Instance.CurrentDBDocument
walls = IN[0]  # Liste de murs

TransactionManager.Instance.EnsureInTransaction(doc)

updated = 0
for wall in walls:
    # Volume (via LookupParameter, marche sur 2026.4)
    vol_param = wall.LookupParameter("Volume")
    vol_m3 = 0
    if vol_param and vol_param.HasValue:
        vol_ft3 = vol_param.AsDouble()
        vol_m3 = vol_ft3 * 0.028316846592  # pieds³ → m³

    # Coût unitaire (180 €/m³ par défaut)
    cu_param = wall.LookupParameter("Coût unitaire €/m³")
    cu = 180.0
    if cu_param and cu_param.HasValue:
        cu = cu_param.AsDouble()

    # Coût total
    cout_total = round(vol_m3 * cu, 2)
    total_param = wall.LookupParameter("Coût total €")
    if total_param:
        total_param.Set(cout_total)

    # Corps d'état
    ce_param = wall.LookupParameter("Corps d'état")
    if ce_param:
        ce_param.Set("Gros-Œuvre")

    updated += 1

TransactionManager.Instance.TransactionTaskDone()

OUT = f"{updated} murs mis à jour ! (Revit 2026.4)"
# ----------------------------------------
